# Grasshopper definition Sitzschale_Experiment01.gh (Grasshopper 1.0.7)
# plug-ins: Pufferfish

number_slider = Slider(31, range=0..100)
number_slider_2 = Slider(10, range=0..100)
negative = Negative(Value=number_slider)
negative_2 = Negative(Value=number_slider_2)
construct_domain = ConstructDomain(DomainStart=number_slider, DomainEnd=negative)
construct_domain_2 = ConstructDomain(DomainStart=number_slider_2, DomainEnd=negative_2)
number_slider_3 = Slider(1, range=0..1)
series = Series(Start="0", Step=Slider(2.666, range=0..10), Count=Slider(30, range=0..100))
rectangle = Rectangle(Plane=PlaneXY(0, 0, 0), XSize=construct_domain, YSize=construct_domain_2, Radius=number_slider_2)  # -> Rectangle, Length
curve = Curve(rectangle.Rectangle)
offset_curve = OffsetCurve(Curve=curve, Distance=series, Plane=PlaneXY(0, 0, 0), Corners=1)  # -> flatten(Curve)
dispatch = Dispatch(List=offset_curve, DispatchPattern=[True, False])  # -> ListA, ListB
curve_2 = Curve(curve)
curve_3 = Curve(dispatch.ListA)
curve_4 = Curve(dispatch.ListB)
divide_curve = DivideCurve(Curve=curve_2, Count=Slider(27, range=0..100), Kinks=False)  # -> Points, Tangents, Parameters
evaluate_curve = EvaluateCurve(Curve=curve_2, Parameter=divide_curve.Parameters)  # -> Point, Tangent, Angle
curve_frame = CurveFrame(Curve=curve_2, Parameter=divide_curve.Parameters)
deconstruct_plane = DeconstructPlane(Plane=curve_frame)  # -> Origin, XAxis, YAxis, ZAxis
list_item = ListItem(List=series, Index="-1", Wrap=True)
reverse = Reverse(Vector=deconstruct_plane.YAxis)
line_sdl = LineSDL(Start=evaluate_curve.Point, Direction=reverse, Length=list_item)
offset_curve_2 = OffsetCurve(Curve=line_sdl, Plane=PlaneXY(0, 0, 0), Distance=Slider(3.8, range=0..15), BothSides="true", Kinks=0, CapType="2")
curve_5 = Curve(reparameterize(curve_4))
curve_6 = Curve(reparameterize(curve_3))
dispatch_2 = Dispatch(List=flatten(offset_curve_2), DispatchPattern=[True, False])  # -> ListA, ListB
curve_7 = Curve(reparameterize(dispatch_2.ListA))
curve_8 = Curve(reparameterize(dispatch_2.ListB))
trim_with_regions = TrimWithRegions(Curve=graft(curve_5), Regions=flatten(curve_8))  # -> Inside, Outside
trim_with_regions_2 = TrimWithRegions(Curve=graft(curve_6), Regions=flatten(curve_7))  # -> Inside, Outside
curve_9 = Curve(trim_with_regions.Outside)
curve_10 = Curve(trim_with_regions_2.Outside)
merge = Merge(Data1=curve_10, Data2=curve_9)
curve_11 = Curve(merge)
